# Grasshopper definition CNC_DRAW_CHANNEL_CONTROL.gh (Grasshopper 0.9.70)

pt = Point([<point referenced from the Rhino model> x5000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])
Y = UnitY(Factor=0.4965)
Y_2 = UnitY(Factor=-0.4965)
move = Move(Geometry=pt, Motion=Y)  # -> Geometry, Transform
move_2 = Move(Geometry=pt, Motion=Y_2)  # -> Geometry, Transform
ln = Line(StartPoint=move.Geometry, EndPoint=move_2.Geometry)
project = Project(Geometry=ln, Plane=PlaneXY(0, 0, 0))  # -> Geometry, Transform
join = JoinCurves(Curves=project.Geometry, Preserve=False)
